# Grasshopper definition vultureDefinition.gh (Grasshopper 0.9.76)
# plug-ins: VultureGH

height = Slider(5, range=0..10)
number_slider = Slider(10, range=0..10)
anglestep = Slider(1, range=0..1)
rotation = Slider(8.31, range=0..10)
distance = Slider(48, range=0..100)
ellipse = Ellipse(Plane=PlaneXY(0, 0, 0), Radius1=Slider(10, range=0..10), Radius2=Slider(5.89, range=0..10))  # -> Ellipse, Focus1, Focus2
series = Series(Start=0, Step=height, Count=number_slider)
series_2 = Series(Start=0, Step=anglestep, Count=number_slider)
Z = UnitZ(Factor=series)
move = Move(Geometry=ellipse.Ellipse, Motion=Z)  # -> Geometry, Transform
mbox = MeshBox(Base={Plane=PlaneXY(0, 0, 0), X=Domain(-10, 10), Y=Domain(-10, 10), Z=Domain(-10, 10)}, XCount=1, YCount=1, ZCount=1)
rotate = Rotate(Geometry=move.Geometry, Angle=series_2, Plane=PlaneXY(0, 0, 0))  # -> Geometry, Transform
rotate_2 = Rotate(Geometry=mbox, Angle=rotation, Plane=PlaneXY(0, 0, 0))  # -> Geometry, Transform
X = UnitX(Factor=distance)
loft = Loft(Curves=rotate.Geometry, Options={Adjust=False, Closed=False, LoftEnds=0, LoftSimp=0, LoftType=0, Rebuild=10, Refit=0.01})
move_2 = Move(Geometry=rotate_2.Geometry, Motion=X)  # -> Geometry, Transform
cap = CapHoles(Brep=loft)

# ---- group: VULTURE HOW TO
vulture = VultureGH(
    Mesh=flatten([move_2.Geometry, cap]),
    Points=flatten(Point(0, 0, 0)),
    Numbers=flatten(0),
    Text=flatten(""),
    SendCam=Toggle(False),
    Path="C:\Dropbox\# WORK\VVVVulture\Sample File\test",
    Enable=Toggle(False))

# ---- group: Connect Timer to Vulture to constantly update RhCam
timer = Timer(TimerInterval=20)
